% Requirement links of Adaptive_Cruise_Control_Logic.slx (R2021a)

block :10 implements Adaptive_Cruise_Control_Requirements.docx#@Simulink_requirement_item_1: Requirement Document
block :20 implements Requairement_Document_ACC.docx#@Simulink_requirement_item_3: Requirement 3 – Adaptive Cruise Control Algorithm:
block :29:1 implements Adaptive_Cruise_Control_Requirements.docx#@Simulink_requirement_item_4: ACC OFF MODE state logic
block :29:10 implements Adaptive_Cruise_Control_Requirements.docx#@Simulink_requirement_item_8: LeadVehicle_Detected_Resume
block :29:11 implements Adaptive_Cruise_Control_Requirements.docx#@Simulink_requirement_item_9: LeadVehicle_Not_Detected_Resume
block :29:23 implements Adaptive_Cruise_Control_Requirements.docx#@Simulink_requirement_item_10: LeadVehicle_Speed_lessthan_Set_Speed
block :29:24 implements Adaptive_Cruise_Control_Requirements.docx#@Simulink_requirement_item_11: LeadVehicle_Speed_equal_Set_Speed
block :29:3 implements Adaptive_Cruise_Control_Requirements.docx#@Simulink_requirement_item_4: ACC STANDBY MODE state logic
block :29:6 implements Adaptive_Cruise_Control_Requirements.docx#@Simulink_requirement_item_5: ACC ON MODE state logic:
block :29:7 implements Adaptive_Cruise_Control_Requirements.docx#@Simulink_requirement_item_6: LeadVehicle_Detected_Follow
block :29:9 implements Adaptive_Cruise_Control_Requirements.docx#@Simulink_requirement_item_7: LeadVehicle_Not_Detected
block :31 implements Requairement_Document_ACC.docx#@Simulink_requirement_item_2: Requirement 2 – Drive Vehicle:
block :39 implements Requairement_Document_ACC.docx#@Simulink_requirement_item_1: Requirement 1– Lead Vehicle:
block :47:1 implements Adaptive_Cruise_Control_Requirements.docx#@Simulink_requirement_item_10: LeadVehicle_Speed_lessthan_Set_Speed
block :47:2 implements Adaptive_Cruise_Control_Requirements.docx#@Simulink_requirement_item_11: LeadVehicle_Speed_equal_Set_Speed
block :47:25 implements Adaptive_Cruise_Control_Requirements.docx#@Simulink_requirement_item_4: ACC STANDBY MODE state logic
block :47:26 implements Adaptive_Cruise_Control_Requirements.docx#@Simulink_requirement_item_5: ACC ON MODE state logic:
block :47:28 implements Adaptive_Cruise_Control_Requirements.docx#@Simulink_requirement_item_4: ACC OFF MODE state logic
block :47:3 implements Adaptive_Cruise_Control_Requirements.docx#@Simulink_requirement_item_7: LeadVehicle_Not_Detected
block :47:4 implements Adaptive_Cruise_Control_Requirements.docx#@Simulink_requirement_item_9: LeadVehicle_Not_Detected_Resume
block :47:5 implements Adaptive_Cruise_Control_Requirements.docx#@Simulink_requirement_item_8: LeadVehicle_Detected_Resume
block :47:6 implements Adaptive_Cruise_Control_Requirements.docx#@Simulink_requirement_item_6: LeadVehicle_Detected_Follow